# Grasshopper definition LearnCarbon.gh (Grasshopper 1.0.7)
# plug-ins: Hops

panel = Panel("Location")
panel_2 = Panel("Option A")
panel_3 = Panel("Building Type")
panel_4 = Panel("Option B")
panel_5 = Panel("Total Area")
panel_6 = Panel("Number of Floors")
panel_7 = Panel("Foot Print")
panel_8 = Panel("Type Structure")
panel_9 = Panel("Total Carbon")

lo = Panel("1")
bt = Panel("1")
ta = Panel("2000")
fp = Panel("1")
nf = Panel("1")

ts = Panel("1")
tc = Panel("1")
oa = Panel("1")

python = GhPythonScript(StructureType=ts)  # -> out, a; inputs StructureType: Int32
# ---------- python: Python ----------
__author__ = "karimd"
__version__ = "2021.10.31"

import rhinoscriptsyntax as rs


if StructureType == 0:
    a = "Concrete"
if StructureType == 1:
    a = "Steel-Concrete"
if StructureType == 2:
    a = "Wood"
if StructureType == 3:
    a = "Wood-Hybrid"
# ---------- end python ----------

# ---- group: C02 Prediction
hops = Hops(
    ConstructionType=ts,
    BuildingType=bt,
    Location=lo,
    Area=ta,
    FloorCount=nf,
    CacheResultsInMemory=False,
    CacheSolveResults=False,
    RemoteDefinitionLocation="http://127.0.0.1:5000/getPrediction",
    RemoteSolveVersion=(0, 1, 0),
    ShowInput_Enabled=False,
    ShowInput_Path=False,
    SynchronousSolve=True)
panel_10 = Panel(hops)

# ---- group: Construction Type Prediction
hops_2 = Hops(
    TargetC02=tc,
    BuildingType_b=bt,
    Location_b=lo,
    TotalArea=ta,
    FloorCount_b=nf,
    CacheResultsInMemory=False,
    CacheSolveResults=False,
    RemoteDefinitionLocation="http://127.0.0.1:5000/getConstructionType",
    RemoteSolveVersion=(0, 1, 0),
    ShowInput_Enabled=False,
    ShowInput_Path=False,
    SynchronousSolve=True)
panel_11 = Panel(hops_2)

# ----
panel_12 = Panel(python.a)
filter = StreamFilter(Gate=oa, Stream0=hops_2, Stream1=hops)
ot = Panel(filter)
